# Grasshopper definition firefly_arduino.gh (Grasshopper 1.0.7)
# plug-ins: Firefly.Core

com_ports_available = COMPortsAvailable()
panel = Panel(com_ports_available)
trigger = Trigger(Interval=100, TimerInterval=100, Target=serial_read_generic)
serial_read_generic = SerialReadGeneric(StartReadingValues=Toggle(True), PortNumber=com_ports_available)  # -> SerialOutput, StatusMessage
mesh = Mesh(<mesh referenced from the Rhino model>)
mesh_2 = Mesh(<mesh referenced from the Rhino model>)
open_close_port = OpenClosePort(OpenClosePort=Toggle(True), PortNumber=panel, BaudRate="9600")
panel_2 = Panel(serial_read_generic.SerialOutput)
panel_3 = Panel(serial_read_generic.StatusMessage)
panel_4 = Panel(open_close_port)
ghpython_script = GhPythonScript(touch_state=panel_2)  # -> out, zPos
# ---------- ghpython_script: Python ----------
__author__ = "GRlab"
__version__ = "2021.11.24"

import rhinoscriptsyntax as rs

if touch_state in "ra_sharp":
    zPos = -2
else:
    zPos = 0
# ---------- end ghpython_script ----------
panel_5 = Panel(ghpython_script.zPos)
unit_z = UnitZ(Factor=panel_5)
move = Move(Geometry=mesh_2, Motion=unit_z)  # -> Geometry, Transform
